# Grasshopper definition polymorphicTypeTest.gh (Grasshopper 0.9.75)
# plug-ins: Agent

number_slider = Slider(5, range=0..10)
particle = ConstructParticle(
    MinimumInitialVelocity=Vector(-0.1, -0.1, -0.1),
    MaximumInitialVelocity=Vector(0.1, 0.1, 0.1),
    Acceleration=Vector(0, 0, 0),
    Lifespan=Slider(150, range=0..1000),
    Mass=1,
    BodySize=1,
    HistoryLength=1)
agent = ConstructAgent(Particle=particle, MaxSpeed=0.5, MaxForce=0.1, VisionRadius=5, VisionAngle=360)
ptemit = PointEmitter(ContinuousFlow=True, CreationRate=1, NumberOfParticles=0, Point=Point(0, 0, 0))
timer = Timer(TimerInterval=20, Target=[engine, system])
division = Division(A=number_slider, B=Slider(3, range=0..10))
system = System(Particles=agent, Emitters=ptemit)
pt = Point(<point referenced from the Rhino model>)
deconstructsystem = DeconstructSystem(System=system)  # -> Particles, AgentCollection
neighbors = GetNeighborsInRadius(
    Agent=deconstructsystem.Particles,
    AgentCollection=deconstructsystem.AgentCollection,
    VisionRadius=number_slider,
    VisionAngle=360)
engine = Engine(Reset=Toggle(False), System=system)
neighbors_2 = GetNeighborsInRadius(Agent=deconstructsystem.Particles, AgentCollection=neighbors, VisionRadius=division, VisionAngle=360)
deconstructagent = DeconstructAgent(Agent=deconstructsystem.Particles)  # -> Position, Velocity, Acceleration, Lifespan, ReferencePosition
attract = AttractForce(
    Apply=True,
    Agent=deconstructsystem.Particles,
    WeightMultiplier=1,
    TargetPoint=pt,
    Mass=1,
    DistanceLowerLimit=5,
    DistanceUpperLimit=100)
cohese = CoheseForce(Apply=True, Agent=deconstructsystem.Particles, WeightMultiplier=1, GetNeighborsInRadius=neighbors)
separate = SeparateForce(Apply=True, Agent=deconstructsystem.Particles, WeightMultiplier=1, GetNeighborsInRadius=neighbors_2)
