# Grasshopper definition polysrfEnvTest.gh (Grasshopper 0.9.75)
# plug-ins: Agent

# ----
# POINT EMITTER
# Point from which to emit agents.
# If continuous flow, Agents will be consistently emitted. Limit the number of agnets allowed at once with the Number of Agents setting.
toggle = BooleanToggle(True)
agent_vision_radius_multiplier = Slider(3, range=0..10)
agent_cohesion_vision_radius = Slider(5, range=0..10)

# ----
# CONSTRUCT AGENT
# Agent Settings:
# Initializes agents with these settings. The settings cannot change once the agent has been emitted. If there is just 1 Agent output from A, all the agents will have that setting. If you would like a diversity of agent settings for each agent, feed in a list of values into the settings you would like to be different.
number_slider = Slider(150, range=0..1000)
brep = Brep(<brep referenced from the Rhino model>)
ptemit = PointEmitter(Point=Point(0, 0, 0), ContinuousFlow=toggle, CreationRate=1, NumberOfAgents=Slider(100, range=0..100))
agent = ConstructAgent(
    Lifespan=number_slider,
    Mass=1,
    BodySize=1,
    MaxSpeed=Slider(0.5, range=0..1),
    MaxForce=Slider(0.1, range=0..1),
    HistoryLength=1)
polysrfenv = PolysurfaceEnvironment(Brep=brep)
# SYSTEM
# Creates a system of Agents that the engine will be able to run.
system = System(Agents=agent, Emitters=ptemit, Environment=polysrfenv)
# Pause the simlation by double-clicking the Timer.
timer = Timer(TimerInterval=20, Target=[engine, system])
# Reset the simulation by double-clicking the reset switch.
toggle_2 = BooleanToggle(False)
# DECONSTRUCT SYSTEM
# Exposes the list of Agents, A, and the AgentCollection, AC, which is a spatial data structure that allows for the fast lookup of neighbors.
# The Agent's vision radius for separation here has a stable ratio to the cohesion vision radius so that a stable behavior is formed
division = Division(A=agent_cohesion_vision_radius, B=agent_vision_radius_multiplier)
deconstructsystem = DeconstructSystem(System=system)  # -> Agents, AgentCollection
engine = Engine(Reset=toggle_2, System=system)
# Finds all agents 5 units away
neighbors = GetNeighborsInRadius(
    Agent=deconstructsystem.Agents,
    AgentCollection=deconstructsystem.AgentCollection,
    VisionRadius=agent_cohesion_vision_radius,
    VisionAngle=360)
deconstructagent = DeconstructAgent(Agent=deconstructsystem.Agents)  # -> Position, Velocity, Acceleration, Lifespan, ReferencePosition
pt = Point(deconstructagent.Position)
# DECONSTRUCT AGENT:
# Exposes the Agents' Position and other fields so you can see them.
pt_2 = Point(deconstructagent.ReferencePosition)
# Looks at all agents within 5 units away and finds the ones within 5/3 units away - this makes the runtime faster
neighbors_2 = GetNeighborsInRadius(Agent=deconstructsystem.Agents, AgentCollection=neighbors, VisionRadius=division, VisionAngle=360)
# COHESE AND SEPARATE:
# A takes in agent. This will look at each individual agent in the system.
# AC takes in output from neighbors component to get all of the neighbors within the vision radius.
# W is the strength of the force. Default to 1.
separate = SeparateForce(Agent=deconstructsystem.Agents, Apply=True, WeightMultiplier=1, GetNeighborsInRadius=neighbors_2)
cohese = CoheseForce(Agent=deconstructsystem.Agents, Apply=True, WeightMultiplier=1, GetNeighborsInRadius=neighbors)  # disabled
item = ListItem(List=deconstructagent.Position, Index=0, Wrap=True)
# You can preview the force vectors from each force component by using the vector preview component.
vdis = VectorDisplay(Anchor=flatten(item), Vector=separate)
