# Grasshopper definition test.gh (Grasshopper 0.9.75)
# plug-ins: Agent

number_slider = Slider(10, range=0..10)
pt = Point(<point referenced from the Rhino model>)
pt_2 = Point(<point referenced from the Rhino model>)
number_slider_2 = Slider(0.05, range=0..0.1)
number_slider_3 = Slider(1, range=0..10)
box = DomainBox(Base=pt, X=number_slider, Y=number_slider, Z=number_slider)
pemit = PointEmitter(Point=pt_2, ContinuousFlow=True, CreationRate=1, NumberOfAgents=0)
wboxenv = WorldBoxEnvironment(Box=box)
agent = Agent(
    Lifespan=Slider(500, range=0..1000),
    Mass=1,
    BodySize=1,
    MaximumSpeed=0.5,
    MaximumForce=Slider(0.01, range=0..0.01),
    VisionAngle=15,
    VisionRadius=5,
    LengthOfPositionHistory=1)
avoidedges = AvoidEdgesForce(Weight=1, VisionMultiplier=Slider(0.5, range=0..1), Environment=wboxenv)
bouncecontainbev = BounceContainBehavior(Environment=wboxenv)
system = AgentSystem(Agents=agent, Emitters=pemit, Forces=avoidedges, Behaviors=bouncecontainbev)
timer = Timer(TimerInterval=20, Target=engine)
engine = Engine(Reset=Toggle(False), LiveUpdate=True, Systems=system)
debugdeconstructagent = DebugDeconstructAgent(Agent=engine)  # -> Position, Velocity, Acceleration, Lifespan, RefPosition
