# Grasshopper definition test2.gh (Grasshopper 0.9.75)
# plug-ins: Agent

pt = Point(<point referenced from the Rhino model>)
pemit = PointEmitter(Point=pt, ContinuousFlow=Toggle(False), CreationRate=1, NumberOfAgents=Slider(10000, range=0..10000))
agent = Agent(
    Lifespan=30,
    Mass=1,
    BodySize=1,
    MaximumSpeed=0.5,
    MaximumForce=0.1,
    VisionAngle=15,
    VisionRadius=5,
    LengthOfPositionHistory=1)
system = AgentSystem(Agents=agent, Emitters=pemit)
timer = Timer(TimerInterval=20, Target=[engine, engine2])  # disabled
toggle = BooleanToggle(True)
engine2 = Engine2(Reset=toggle, LiveUpdate=True, Systems=system)
engine = Engine(Reset=toggle, LiveUpdate=True, Systems=system)  # disabled
deconstructagent = DeconstructAgent(Agent=engine)  # -> Position, Velocity, Acceleration, Lifespan; disabled
deconstructagent_2 = DeconstructAgent(Agent=engine2)  # -> Position, Velocity, Acceleration, Lifespan
swatch = ColourSwatch(SwatchColor=RGB(255, 0, 255))  # disabled
preview = CustomPreview(Geometry=deconstructagent.Position, Shader=swatch)  # disabled
preview_2 = CustomPreview(Geometry=deconstructagent_2.Position, Shader=ColourSwatch(SwatchColor=RGB(255, 255, 255)))
